# Grasshopper definition voxel_slices.gh (Grasshopper 1.0.7)
# plug-ins: FreshEyes, LunchBox

platododec = PlatonicDodecahedron(Plane=PlaneXY(0, 0, 0), Radius=10)
platoocta = PlatonicOctahedron(Plane=PlaneXY(0, 0, 0), Radius=10, Truncation=0)
number_slider = Slider(5, range=3..7)

# ---- group: constrain dimensions to a power of 2 (8,16,32,64,128)
_2º = PowerOf2(Value=Slider(4, range=3..7))
panel = Panel(_2º)
res = Integer(_2º)

# ----
cone = Cone(Base=PlaneXY(0, 0, 0), Radius=0.5, Length=1)  # -> Cone, Tip
res_2 = Integer(res)
platotetra = PlatonicTetrahedron(Plane=PlaneXY(0, 0, 0), Radius=10, Truncation=Slider(0, range=0..1))
octahedron = Brep(platoocta)
dodec = Brep(platododec)
cap = CapHoles(Brep=cone.Cone)
sph = Sphere(Base=PlaneXY(0, 0, 0), Radius=Slider(2.3, range=0..10))
pyramid = Brep(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)
one_over_x = OneOverX(Value=res_2)
dstpth = Text("C:\Users\kstei\Desktop\TEMP")
do_it = Boolean(Button())
name = Text("name")
dom = ConstructDomain(DomainStart=expr("x/2", one_over_x), DomainEnd=expr("1-x/2", one_over_x))
mass = Brep(sph)
range = Range(Domain=dom, Steps=expr("x-1", res_2))
mass_2 = Brep(mass)
mass_3 = Brep(mass_2)
bbox = BoundingBox(Content=mass_3, Plane=PlaneXY(0, 0, 0), UnionBox=True)  # -> Box, Box_2
crossref = CrossReference(ListA=range, ListB=range, CrossMode=1)  # -> ListA, ListB
box = EvaluateBox(Box=bbox.Box, UParameter=crossref.ListA, VParameter=crossref.ListB, WParameter=graft(range))  # -> Plane, Point, Include
brepinc = PointInBrep(Brep=mass_3, Point=box.Point, Strict=False)
python = GhPythonScript(bools=brepinc, clr_true=ColourSwatch(SwatchColor=RGB(0, 0, 0)), clr_false=ColourSwatch(SwatchColor=RGB(255, 255, 255)))  # -> out, a; inputs bools: list
# ---------- python: Python ----------
__author__ = "ksteinfe"
__version__ = "2018.11.02"

import rhinoscriptsyntax as rs


img = []
for b in bools:
    if b: img.append(clr_true)
    else: img.append(clr_false)
a = img
# ---------- end python ----------
px_to_img = PixelsToImage(PixelColors=python.a, ImageWidth=-1, ImageHeight=-1)  # -> flatten(Image)
dstpth_2 = Text(dstpth)
name_2 = Text(name)
do_it_2 = Boolean(do_it)
python_2 = GhPythonScript(do_it=do_it_2, savepth=dstpth_2, name=name_2, imgs=px_to_img)  # -> out, a; inputs do_it: Boolean, imgs: list
# ---------- python_2: Python ----------
import clr, os, zipfile
clr.AddReference("System.Drawing")
from System.Drawing import Bitmap
from System.Drawing.Imaging import ImageFormat

if do_it:
    pths = []
    for n, img in enumerate(imgs):
        if any([len(imgs)!=img.Size.Height, len(imgs)!=img.Size.Width]):
            raise ValueError("DATA ISN'T CUBIC! {}!={}!={}".format(len(imgs),img.Size.Width,img.Size.Height))
            do_it = False
            break
        
        pth = os.path.join(savepth,"{:03d}.gif".format(n))
        img.Save(pth, ImageFormat.Gif)
        pths.append(pth)
        
if do_it:
    # ZIP it up
    ziph = zipfile.ZipFile(os.path.join(savepth, "{:03d}_{}.zip".format(len(imgs),name)), 'w', zipfile.ZIP_DEFLATED)
    for file in pths: 
        arcname = os.path.relpath(file, savepth)
        ziph.write(file,arcname)
    ziph.close()
    
    # erase files
    for file in pths: os.remove(file)
# ---------- end python_2 ----------
